# Dynamo graph Enable_AnalyticalModel_script.dyn (Dynamo 2.6.1.8786)

# group: License
# note: GNU License
# This program is free software, you can redistribute it and/or modify it under the terms GNU General Public License as pubmished by the Free Software Foundation, either version 3 of the License, or (at your option) any later version.
# This program is distributed in the hope that it will be useful, but WITHOUT ANY WARRANTY, without even the implied warranty of MERCHANTABILITY or FITNESS FOR A PARTICULAR PURPOSE. See the GNU General Public License for more details.
# You should have received a copy of the GNU General Public License along with this program. If not, see http://www.gnu.org/licenses/

# group: Background
# note: for workflow

# group: Input
# note: for selection and whatnot

# group: Control
# note: for sliders and other option

# group: To Revit
# note: for changes made to Revit

# group: Annotation
# note: for notes and titles

# group: Info
# note: for general information

# group: Other
# note: for general other needs

# group: Background
# note: SHOUTOUTS!
# To KAte and Sol Amour in this thread
# https://revitforum.org/showthread.php/38481-Dynamo-Disable-Analytical-Model
# note: in this python script there is a number '0' that indicates analytical model is initially turned off
python_script = Python()  # unwired: IN[0]
# ---------- python_script.python (39 lines) ----------
"""
FILTERED ELEMENT COLLECTOR - ANALYTICAL MODEL PARAMETER ELEMENTS ONLY
"""
__author__ = 'Sol Amour - sol.amour@designtech.io'
__twitter__ = '@solamour'
__copyright__ = 'designtech.io 2018'
__version__ = '1.0.0'


# Importing Reference Modules
import clr # CLR ( Common Language Runtime Module )
clr.AddReference("RevitServices") # Adding the RevitServices.dll special Dynamo module to deal with Revit
import RevitServices # Importing RevitServices
from RevitServices.Persistence import DocumentManager # From RevitServices import the Document Manager
clr.AddReference("RevitAPI") # Adding the RevitAPI.dll module to access the Revit API
import Autodesk # Here we import the Autodesk namespace
# From the Autodesk namespace - derived down to the Revit Database, we import only the Filtered Element Collector and BuiltInCategory classes
from Autodesk.Revit.DB import *

# Here we give the Revit Document a nickname of 'doc' which allows us to simply call 'doc' later without having to type the long namespace name 
doc = DocumentManager.Instance.CurrentDBDocument

# Here we use the Built In Parameter method to choose the parameter (yes/no tickbox) of 'Enable Analytical Model' across all Elements inside of the Revit Document
param = BuiltInParameter.STRUCTURAL_ANALYTICAL_MODEL
# Once we have our BuiltInParameter, we need to get it's Element Id and convert it to a Parameter Value Provider in order to use it inside of our filter
provider = ParameterValueProvider( ElementId( param ) )

# We then set up an empty instance of a Filter Numeric Equals to test against a set value (In this case - whether or not the Element has the box ticked for 'Enable Analytical Model'
evaluator = FilterNumericEquals()
# After we have the empty instance set up as our evaluator, we run a Filter Integer Rule that checks the chosen parameter (Enable Anyalytical Model), runs against the evaluator (Does this Number equal) and our value (1 which correlates to the tick inside of our yes/no tickbox)
rule = FilterIntegerRule( provider, evaluator, 0 )
# After we have generated our Rule, we can generate a filter based off this rule
filter = ElementParameterFilter( rule )

# Now we have a valid rule to run against our Filtered Element Collector. So in this case we pull everything inside the document - but only if it passes our filter (i.e has the box ticked on for 'Enable Analytical Model') then make sure we return the elements themselves. 
analyticalCollector = FilteredElementCollector( doc ).WherePasses( filter ).ToElements()

# To get our results back inside of Dynamo, we need to append a list to the OUT port
OUT = analyticalCollector
# ----------------------------------------
string = StringInput("Enable Analytical Model")
boolean = BoolSelector(true)

# group: To Revit
setParameterByName = Element.SetParameterByName(element=python_script, parameterName=string, value=boolean)
