# Dynamo graph insert_tag_FFL_script.dyn "inputFFL" (Dynamo 2.6.1.8786)

# group: Get Levels elevation from ground and round off to 2 decimal
code_block = CodeBlock { "Levels"; }
byName = Category.ByName(name=code_block)
all_elements_of_category = ElementsOfCategory(Category=byName)
name = Level.Name(level=all_elements_of_category)
code_block_2 = CodeBlock { "Elevation"; }
getParameterValueByName = Element.GetParameterValueByName(element=all_elements_of_category, parameterName=code_block_2)
code_block_3 = CodeBlock { 1000; }
div = getParameterValueByName / code_block_3
python_script = Python(IN[0]=div)
# ---------- python_script.python (20 lines) ----------
# Load the Python Standard and DesignScript Libraries
import sys
import clr
clr.AddReference('ProtoGeometry')
from Autodesk.DesignScript.Geometry import *

# The inputs to this node will be stored as a list in the IN variables.
dataEnteringNode = IN

x=IN[0]

d=[]

for a in x:
	p = "%0.2f"%(a)
	d.append(p)
	
# Assign your output to the OUT variable.

OUT = d
# ----------------------------------------

# group: Get Rooms and the shared parameter 'Finished Floor Level'
code_block_4 = CodeBlock { "Rooms"; }
byName_2 = Category.ByName(name=code_block_4)
all_elements_of_category_2 = ElementsOfCategory(Category=byName_2)
code_block_5 = CodeBlock { "Level"; }
getParameterValueByName_2 = Element.GetParameterValueByName(element=all_elements_of_category_2, parameterName=code_block_5)
groupByKey = List.GroupByKey(list=all_elements_of_category_2, keys=getParameterValueByName_2)
code_block_6 = CodeBlock { "Finished Floor Level"; }
setParameterByName = Element.SetParameterByName(element=groupByKey.groups, parameterName=code_block_6, value=python_script)
watch = Watch(setParameterByName)
