# Dynamo graph Delete_ImportedLineStyle_Script.dyn "Delete_ImportedLineStyle_script" (Dynamo 2.6.1.8786)
# packages: Clockwork for Dynamo 2.x 2.3.0, Rhythm 2020.9.8

# group: License
# note: GNU License
# This program is free software, you can redistribute it and/or modify it under the terms GNU General Public License as pubmished by the Free Software Foundation, either version 3 of the License, or (at your option) any later version.
# This program is distributed in the hope that it will be useful, but WITHOUT ANY WARRANTY, without even the implied warranty of MERCHANTABILITY or FITNESS FOR A PARTICULAR PURPOSE. See the GNU General Public License for more details.
# You should have received a copy of the GNU General Public License along with this program. If not, see http://www.gnu.org/licenses/

# group: Background
# note: for workflow

# group: Input
# note: for selection and whatnot

# group: Control
# note: for sliders and other option

# group: To Revit
# note: for changes made to Revit

# group: Annotation
# note: for notes and titles

# group: Info
# note: for general information

# group: Other
# note: for general other needs

# group: Input
# note: SHOUTOUTS!
# to Konrad K Sobon/archi-lab for this script idea. Please refer to blog post https://archi-lab.net/delete-imported-line-patterns-using-dynamo/
code_block = CodeBlock { "LinePatternElement"; }
# note: Custom Node: Clockwork v.2.3.0
byName = Custom[ElementType.ByName](name=code_block)  # package Clockwork for Dynamo 2.x; Retrieves an element type by its name - to be used with the OOTB node "All Elements of Type".
all_elements_of_type = ElementsOfType(element_type=byName)

# group: Background
flatten = List.Flatten(list=all_elements_of_type)
name = Element.Name(element=flatten)
watch = Watch(name)
count = List.Count(list=name)
code_block_2 = CodeBlock { "IMPORT"; false; }
contains = String.Contains(str=name, searchFor=code_block_2.out0, ignoreCase=code_block_2.out1)
filterByBoolMask = List.FilterByBoolMask(list=flatten, mask=contains)

# group: To Revit
code_block_3 = CodeBlock { "Delete Imported Line Pattern"; }
python_script = Python(IN[0]=filterByBoolMask.in)
# ---------- python_script.python (47 lines) ----------
#Copyright(c) 2014, Konrad Sobon
# @arch_laboratory, http://archi-lab.net

import clr
clr.AddReference('ProtoGeometry')
from Autodesk.DesignScript.Geometry import *

# Import DocumentManager and TransactionManager
clr.AddReference("RevitServices")
import RevitServices
from RevitServices.Persistence import DocumentManager
from RevitServices.Transactions import TransactionManager

# Import RevitAPI
clr.AddReference("RevitAPI")
import Autodesk
from Autodesk.Revit.DB import *

doc = DocumentManager.Instance.CurrentDBDocument
uiapp = DocumentManager.Instance.CurrentUIApplication
app = uiapp.Application

from System.Collections.Generic import *

#The inputs to this node will be stored as a list in the IN variable.
dataEnteringNode = IN

#unwrap all elements to use with API
elements = []
for i in IN[0]:
	elements.append(UnwrapElement(i))

idsToDelete = List[Autodesk.Revit.DB.ElementId]()
for i in elements:
	idsToDelete.Add(i.Id)

# "Start" the transaction
TransactionManager.Instance.EnsureInTransaction(doc)

doc.Delete(idsToDelete)

# "End" the transaction
TransactionManager.Instance.TransactionTaskDone()

message = "You have successfully deleted n " + str(idsToDelete.Count) + " elements from Revit model."

OUT = 'n'.join('{:^35}'.format(s) for s in message.split('n'))
# ----------------------------------------
watch_2 = Watch(python_script)
ʳʰʸᵗʰᵐ_helpers_simpleusermessage = Rhythm.Revit.Helpers.Helpers.SimpleUserMessage(caption=code_block_3, message=watch_2)
