# Dynamo graph Create_Schedule_PercentageOpening_script.dyn (Dynamo 2.6.1.8786)
# packages: Clockwork for Dynamo 2.x 2.3.0, archi-lab.net 2021.25.21

# group: Initial Setup
# note: README
# 1. Custom Packages required
# - Clockwork (Room.Doors and Room.Windows nodes)
# -archilab (key schedule node)
# 2. Tips
# - Make sure all excel file closed.
# - Save as the excel file or it will be closed without saving
# - you need to create the key schedule first, create the parameters same as table headers
# - make sure you have the schedule 'Room Opening Percentage' template or else it won't work
# - DO NOT create key schedule project parameter name same as built-in parameter e.g 'Room Level' not 'Level'
# - Table header node and key schedule parameters name/order must be the same or else it will skip the column entirely
categories = Categories("OST_Rooms")
all_elements_of_category = ElementsOfCategory(Category=categories)
select_phase = RevitPhases()  # nothing selected

# group: Get Room associated level
code_block = CodeBlock { "Level"; }
getParameterValueByName = Element.GetParameterValueByName(element=all_elements_of_category, parameterName=code_block)

name = Room.Name(room=all_elements_of_category)

# group: Door data collection
doors = Custom[Room.Doors](room=all_elements_of_category, phase=select_phase)  # package Clockwork for Dynamo 2.x; Retrieves all doors that are associated with a room (hosted in walls and roofs).
string = StringInput("Width")
string_2 = StringInput("Height")
string_3 = StringInput("Type Mark")

# group: Filter out interior door
code_block_2 = CodeBlock { "Type"; }
parameterByName = Parameter.ParameterByName(element=doors, name=code_block_2)
value = Parameter.Value(parameter=parameterByName)
code_block_3 = CodeBlock { "Function"; }
parameterByName_2 = Parameter.ParameterByName(element=value, name=code_block_3)
string_from_object = FromObject(obj=parameterByName_2)
code_block_4 = CodeBlock { "Exterior"; }
contains = String.Contains(str=string_from_object, searchFor=code_block_4)
filterByBoolMask = List.FilterByBoolMask(list=doors, mask=contains)
watch = Watch(filterByBoolMask.in)
watch_2 = Watch(filterByBoolMask.out)

# group (continued): Door data collection
elementType = Element.ElementType(element=watch)
getParameterValueByName_2 = Element.GetParameterValueByName(element=elementType, parameterName=string)
getParameterValueByName_3 = Element.GetParameterValueByName(element=elementType, parameterName=string_2)
getParameterValueByName_4 = Element.GetParameterValueByName(element=elementType, parameterName=string_3)

# group: Window data collection
windows = Custom[Room.Windows](room=all_elements_of_category, phase=select_phase)  # package Clockwork for Dynamo 2.x; Retrieves all windows that are associated with a room (hosted in walls and roofs).
elementType_2 = Element.ElementType(element=windows)
string_4 = StringInput("Width")
getParameterValueByName_5 = Element.GetParameterValueByName(element=elementType_2, parameterName=string_4)
string_5 = StringInput("Height")
getParameterValueByName_6 = Element.GetParameterValueByName(element=elementType_2, parameterName=string_5)
string_6 = StringInput("Type Mark")
getParameterValueByName_7 = Element.GetParameterValueByName(element=elementType_2, parameterName=string_6)

# group: Opening area calculation
code_block_5 = CodeBlock { 1000; }
div = getParameterValueByName_2 / code_block_5
div_2 = getParameterValueByName_3 / code_block_5
area_from_doors = div * div_2
code_block_6 = CodeBlock { 1000; }
div_3 = getParameterValueByName_5 / code_block_6
div_4 = getParameterValueByName_6 / code_block_6
area_from_windows = div_3 * div_4

# group: Opening percentage calculation
area = Room.Area(room=all_elements_of_category)
list_create = List.Create(item0=area_from_doors, item1=area_from_windows)
sum = Math.Sum(values=list_create)
transpose = List.Transpose(lists=sum)
opening_area = Math.Sum(values=transpose)
code_block_7 = CodeBlock(openingArea=opening_area, roomArea=area) { (openingArea/roomArea)*100; }

# group: Round up to 2 decimal points
code_block_8 = CodeBlock { 2; }
round = Math.Round(number=area, digits=code_block_8)
code_block_9 = CodeBlock { 2; }
round_2 = Math.Round(number=opening_area, digits=code_block_9)
code_block_10 = CodeBlock { 2; }
round_3 = Math.Round(number=code_block_7, digits=code_block_10)

# group: Replace Empty List
code_block_11 = CodeBlock { "N/A"; }
list_create_2 = List.Create(item0=code_block_11)
replaceEmptyLists = Custom[List.ReplaceEmptyLists](seq=getParameterValueByName_4, Replacement=list_create_2)  # package Clockwork for Dynamo 2.x; Replaces all empty lists within a given list with a substitute
string_from_object_2 = FromObject(obj=replaceEmptyLists)
name_2 = FamilyType.Name(familyType=elementType)
code_block_12 = CodeBlock { "N/A"; }
list_create_3 = List.Create(item0=code_block_12)
replaceEmptyLists_2 = Custom[List.ReplaceEmptyLists](seq=name_2, Replacement=list_create_3)
string_from_object_3 = FromObject(obj=replaceEmptyLists_2)
code_block_13 = CodeBlock { "N/A"; }
list_create_4 = List.Create(item0=code_block_13)
replaceEmptyLists_3 = Custom[List.ReplaceEmptyLists](seq=getParameterValueByName_7, Replacement=list_create_4)
string_from_object_4 = FromObject(obj=replaceEmptyLists_3)
name_3 = FamilyType.Name(familyType=elementType_2)
code_block_14 = CodeBlock { "N/A"; }
list_create_5 = List.Create(item0=code_block_14)
replaceEmptyLists_4 = Custom[List.ReplaceEmptyLists](seq=name_3, Replacement=list_create_5)
string_from_object_5 = FromObject(obj=replaceEmptyLists_4)

# group: Create list of door name and size
string_7 = StringInput(",")
join = String.Join(separator=string_7, string0=string_from_object_2)
flatten = List.Flatten(list=join)
string_8 = StringInput(",")
join_2 = String.Join(separator=string_8, string0=string_from_object_3)
flatten_2 = List.Flatten(list=join_2)

# group: Create list of window name and size
string_9 = StringInput(",")
join_3 = String.Join(separator=string_9, string0=string_from_object_4)
flatten_3 = List.Flatten(list=join_3)
string_10 = StringInput(",")
join_4 = String.Join(separator=string_10, string0=string_from_object_5)
flatten_4 = List.Flatten(list=join_4)

# group: Create list for output
# note: Data Hierrachy
# 0. Table head
# 1. Room Level
# 2. Room name
# 3. Room Area
# 4. Total Opening Area
# 5. Opening percentage
# 6. Door Names
# 7. Door Size
# 8. Window Name
# 9. Window Sizes
list_create_6 = List.Create(item0=getParameterValueByName, item1=name, item2=round, item3=round_2, item4=round_3, item5=flatten, item6=flatten_2, item7=flatten_3, item8=flatten_4)

# group: Table formatting
table_header = CodeBlock { ["Room Level","Room Name","Room Area","Opening Area","Opening Percentage (%)","Door Mark","Door Size","Window Mark","Window Size"]; }
code_block_15 = CodeBlock { 0; }
insert = List.Insert(list=list_create_6, element=table_header, index=code_block_15, lacing=Longest)
transpose_2 = List.Transpose(lists=insert)

# group: Export To Excel
directory_path = Directory("C:\Users\GCUCSBWS112\Desktop")
string_11 = StringInput("Room Opening Percentage")
code_block_16 = CodeBlock { 0; }
boolean = BoolSelector(true)
exportExcel = Data.ExportExcel(filePath=directory_path, sheetName=string_11, startRow=code_block_16, startCol=code_block_16, data=transpose_2, overWrite=boolean)
watch_3 = Watch(exportExcel)

transpose_3 = List.Transpose(lists=list_create_6)

# group: Export as key schedule
views = Views("ROOM OPENING PERCENTAGE")
boolean_2 = BoolSelector(true)
key_schedule = Custom[Key Schedule](viewSchedule=views, data=transpose_3, parameterNames=table_header, upperCase=boolean_2)  # package archi-lab.net; This node will take a key schedule, data and a list of parameters and populate it with infomation from data parameter. Visit www.archi-lab.net for more information on how to prep this node for take off.

watch_4 = Watch(key_schedule)
