# Dynamo graph Create_Paint_Surfaces_script.dyn (Dynamo 2.6.1.8786)
# packages: Data-Shapes 2021.2.94

code_block = CodeBlock { "Painter"; }
code_block_2 = CodeBlock { "Selection"; }
code_block_3 = CodeBlock { "Element Category"; }
code_block_4 = CodeBlock { "Walls"; }
boolean = BoolSelector(false)
textbox_data = Custom[TextBox Data](DefaultText=code_block_4, IsNumberEntry=boolean)  # package Data-Shapes; Create Data for TextBox input in UI.MultipleInputForm ++ . Check out www.data-shapes.net for more informations
boolean_2 = BoolSelector(true)
multipleinputform = Custom[MultipleInputForm ++](Description_optional=code_block_3, Inputs=textbox_data, Toggle=boolean_2)  # package Data-Shapes; Create a form with multiple inputs. see www.data-shapes.net for tutorials and infos!
watch = Watch(multipleinputform.User_Inputs)
byName = Category.ByName(name=watch)
boolean_3 = BoolSelector(false)
selectmodelelements_data = Custom[SelectModelElements Data](InputName=code_block_2, CategoryFilter=byName, SelectSingleElement=boolean_3)  # package Data-Shapes; Creates a Revit element selection input for UI.MultipleInputForm++ . Check out www.data-shapes.net for more infos!
code_block_5 = CodeBlock { "Paint Name"; }
code_block_6 = CodeBlock { "GCU-A-Paint-Yellow Brickwall"; }
boolean_4 = BoolSelector(false)
textbox_data_2 = Custom[TextBox Data](InputName=code_block_5, DefaultText=code_block_6, IsNumberEntry=boolean_4)
list_create = List.Create(item0=selectmodelelements_data, item1=textbox_data_2)
boolean_5 = BoolSelector(true)
multipleinputform_2 = Custom[MultipleInputForm ++](Description_optional=code_block, Inputs=list_create, Toggle=boolean_5)
code_block_7 = CodeBlock { -1; }
dropItems = List.DropItems(list=multipleinputform_2.User_Inputs, amount=code_block_7)
faces = Element.Faces(element=dropItems)
lastItem = List.LastItem(list=multipleinputform_2.User_Inputs)
byName_2 = Material.ByName(name=lastItem)
python_script = Python(IN[0]=faces, IN[1]=byName_2)
# ---------- python_script.python (40 lines) ----------
# Copyright(c) René Castillo Picazo
# México 2017
# cadesigner.mex@gmail.com

import clr

clr.AddReference('RevitAPI')
clr.AddReference('RevitServices')

import Autodesk
import RevitServices

from Autodesk.Revit.DB import *
from RevitServices.Persistence import DocumentManager
from RevitServices.Transactions import TransactionManager

doc =  DocumentManager.Instance.CurrentDBDocument


surfaces = IN[0]
material = UnwrapElement(IN[1])

def PaintFace(surf, mat):
	if not isinstance(surf, list):
		elemRef = surf.Tags.LookupTag('RevitFaceReference')
		elem = doc.GetElement(elemRef)
		face = elem.GetGeometryObjectFromReference(elemRef)
		if not (doc.IsPainted(elem.Id, face)):
			doc.Paint(elem.Id, face, mat.Id)
			return surf
	else:
		[PaintFace(i, mat) for i in surf]
		return surf
        

TransactionManager.Instance.EnsureInTransaction(doc)

OUT = PaintFace(surfaces, material)            

TransactionManager.Instance.TransactionTaskDone()
# ----------------------------------------
