# Dynamo graph Create_Model_PortalFrame_script.dyn (Dynamo 2.6.1.8786)
# packages: Structural Design 2021.1.22, Data-Shapes 2021.2.94

code_block = CodeBlock { "Portal Frame Geometry"; }
code_block_2 = CodeBlock()
# ---------- code_block_2.designscript (7 lines) ----------
"Frame Width";
"Frame Height";
"Rafter Angle";
"Number of Frames";
"Spacing between Frames";
"No of tie beam at rafter";
"Rafter Start and End offset";
# ----------------------------------------
code_block_3 = CodeBlock { 10; 9; 5; 2; 3; 1; 0; }
code_block_4 = CodeBlock { 40; 40; 45; 20; 12; 3; 3; }
code_block_5 = CodeBlock { 12; 15; 10; 5; 9; 2; 0.5; }
code_block_6 = CodeBlock { 1; 1; 5; 1; 1; 1; 0.5; }
slider = Custom[Slider](InputName=code_block_2.out0, Minimum=code_block_3.out0, Maximum=code_block_4.out0, Default_Value=code_block_5.out0, Step=code_block_6.out0)  # package Data-Shapes; Creates slider input for UI.MultipleInputForm ++ . Set the step to decimal value if you want a double slider, or to a integer value if you want an integer slider.
slider_2 = Custom[Slider](InputName=code_block_2.out1, Minimum=code_block_3.out1, Maximum=code_block_4.out1, Default_Value=code_block_5.out1, Step=code_block_6.out1)
slider_3 = Custom[Slider](InputName=code_block_2.out2, Minimum=code_block_3.out2, Maximum=code_block_4.out2, Default_Value=code_block_5.out2, Step=code_block_6.out2)
slider_4 = Custom[Slider](InputName=code_block_2.out3, Minimum=code_block_3.out3, Maximum=code_block_4.out3, Default_Value=code_block_5.out3, Step=code_block_6.out3)
slider_5 = Custom[Slider](InputName=code_block_2.out4, Minimum=code_block_3.out4, Maximum=code_block_4.out4, Default_Value=code_block_5.out4, Step=code_block_6.out4)
slider_6 = Custom[Slider](InputName=code_block_2.out5, Minimum=code_block_3.out5, Maximum=code_block_4.out5, Default_Value=code_block_5.out5, Step=code_block_6.out5)
slider_7 = Custom[Slider](InputName=code_block_2.out6, Minimum=code_block_3.out6, Maximum=code_block_4.out6, Default_Value=code_block_5.out6, Step=code_block_6.out6)
list_create = List.Create(item0=slider, item1=slider_2, item2=slider_3, item3=slider_4, item4=slider_5, item5=slider_6, item6=slider_7)
boolean = BoolSelector(true)
code_block_7 = CodeBlock { 600; }
multipleinputform = Custom[MultipleInputForm ++](Description_optional=code_block, Inputs=list_create, Toggle=boolean, Width_optional=code_block_7)  # package Data-Shapes; Create a form with multiple inputs. see www.data-shapes.net for tutorials and infos!
watch = Watch(multipleinputform.User_Inputs)
code_block_8 = CodeBlock(data=watch) { data[0]; data[1]; data[2]; data[3]; data[4]; data[5]; data[6]; }
byWidthHeightAngles = StructuralDesign.Model.Frame.ByWidthHeightAngles(width=code_block_8.out0, height=code_block_8.out1, angle=code_block_8.out2)
boolean_2 = BoolSelector(true)
copy = StructuralDesign.Model.Frame.Copy(frame2DGeometry=byWidthHeightAngles.2DFrame, withEqualSpacing=boolean_2, numberOfTimes=code_block_8.out3, spacing=code_block_8.out4)
purlins = StructuralDesign.Model.Frame.Purlins(rafters=copy.Beams, dp1=code_block_8.out5, dp2=code_block_8.out6)
code_block_9 = CodeBlock { 1; }
range = Range(start=code_block_9, end=code_block_8.out3, step=code_block_9)
code_block_10 = CodeBlock { 2; }
dropEveryNthItem = List.DropEveryNthItem(list=range, n=code_block_10)
XBracings = StructuralDesign.Model.Frame.XBracings(points=purlins.Points, zones=dropEveryNthItem)
code_block_11 = CodeBlock { 2; }
div = code_block_8.out1 / code_block_11
sideRailsEavesBeams = StructuralDesign.Model.Frame.SideRailsEavesBeams(columns=copy.Columns, heights=div)
XBracings_2 = StructuralDesign.Model.Frame.XBracings(points=sideRailsEavesBeams.Points, zones=dropEveryNthItem)
translate = Geometry.Translate(geometry=XBracings_2, zTranslation=div)

# group: Create Grid
startPoint = Curve.StartPoint(curve=copy.Columns)  # frozen
code_block_12 = CodeBlock { 0; }
getItemAtIndex = List.GetItemAtIndex(list=startPoint@L2, index=code_block_12)
code_block_13 = CodeBlock { 1; }
getItemAtIndex_2 = List.GetItemAtIndex(list=startPoint@L2, index=code_block_13)
byStartPointEndPoint = Grid.ByStartPointEndPoint(start=getItemAtIndex, end=getItemAtIndex_2)
firstItem = List.FirstItem(list=getItemAtIndex)
lastItem = List.LastItem(list=getItemAtIndex)
byStartPointEndPoint_2 = Grid.ByStartPointEndPoint(start=firstItem, end=lastItem)
firstItem_2 = List.FirstItem(list=getItemAtIndex_2)
lastItem_2 = List.LastItem(list=getItemAtIndex_2)
byStartPointEndPoint_3 = Grid.ByStartPointEndPoint(start=firstItem_2, end=lastItem_2)
