# Dynamo graph Create_Legend_DoorSchedule_script.dyn (Dynamo 2.6.1.8786)
# packages: spring nodes 204.1.0

# group: Selecting legend and generic annotations
# note: README
# 1.springs package needed for current selection in revit
# 2. Scale determines the size of box
# 3. only one generic annotation and legend at a time
ꟿ_collect_currentselection = Custom[ꟿ Collect.CurrentSelection]()  # package spring nodes; Gets the currently selected elements. Connect a boolean switch to refresh the selection.
getCategory = Element.GetCategory(element=ꟿ_collect_currentselection)
watch = Watch(getCategory)
string_from_object = FromObject(obj=watch)
string = StringInput("Generic Annotations")
boolean = BoolSelector(false)
contains = String.Contains(str=string_from_object, searchFor=string, ignoreCase=boolean)
filterByBoolMask = List.FilterByBoolMask(list=ꟿ_collect_currentselection, mask=contains)

watch_2 = Watch(filterByBoolMask.in)

# group: Extract parameter values
code_block = CodeBlock { "Component Type"; }
parameterByName = Parameter.ParameterByName(element=filterByBoolMask.out, name=code_block, lacing=Shortest)
string_from_object_2 = FromObject(obj=parameterByName)
code_block_2 = CodeBlock { ": "; }
split = String.Split(str=string_from_object_2, separator0=code_block_2, lacing=Shortest)
lastItem = List.LastItem(list=split, lacing=Longest)
watch_3 = Watch(filterByBoolMask.out)

# group: Determining the closest legend and generic annotations
location = FamilyInstance.Location(familyInstance=watch_2, lacing=Shortest)
curves = Element.Curves(element=watch_3, lacing=Shortest)
startPoint = Curve.StartPoint(curve=curves)
firstItem = List.FirstItem(list=startPoint, lacing=Longest)
distanceTo = Geometry.DistanceTo(geometry=location, other=firstItem, lacing=CrossProduct)
minimumItem = List.MinimumItem(list=distanceTo, lacing=Longest)
allIndicesOf = List.AllIndicesOf(list=distanceTo, item=minimumItem, lacing=Longest)
flatten = List.Flatten(list=allIndicesOf, lacing=Shortest)

# group (continued): Extract parameter values
getItemAtIndex = List.GetItemAtIndex(list=lastItem, index=flatten, lacing=Shortest)
watch_4 = Watch(getItemAtIndex)

# group: Input Values into family
watch_5 = Watch(watch_2)
code_block_3 = CodeBlock { "Door Type Mark"; "Door Width"; "Door Height"; "Door Description"; }
byName = FamilyType.ByName(name=watch_4, lacing=Shortest)
code_block_4 = CodeBlock { "Type Mark"; "Width"; "Height"; "Description"; }
getParameterValueByName = Element.GetParameterValueByName(element=byName, parameterName=code_block_4.out0)
string_from_object_3 = FromObject(obj=getParameterValueByName)
setParameterByName = Element.SetParameterByName(element=watch_5, parameterName=code_block_3.out0, value=string_from_object_3, lacing=Shortest)
getParameterValueByName_2 = Element.GetParameterValueByName(element=byName, parameterName=code_block_4.out1)
string_from_object_4 = FromObject(obj=getParameterValueByName_2)
code_block_5 = CodeBlock { "."; }
split_2 = String.Split(str=string_from_object_4, separator0=code_block_5)
setParameterByName_2 = Element.SetParameterByName(element=watch_5, parameterName=code_block_3.out1, value=split_2, lacing=Shortest)
getParameterValueByName_3 = Element.GetParameterValueByName(element=byName, parameterName=code_block_4.out2)
string_from_object_5 = FromObject(obj=getParameterValueByName_3)
code_block_6 = CodeBlock { "."; }
split_3 = String.Split(str=string_from_object_5, separator0=code_block_6)
setParameterByName_3 = Element.SetParameterByName(element=watch_5, parameterName=code_block_3.out2, value=split_3, lacing=Shortest)
getParameterValueByName_4 = Element.GetParameterValueByName(element=byName, parameterName=code_block_4.out3)
string_from_object_6 = FromObject(obj=getParameterValueByName_4)
setParameterByName_4 = Element.SetParameterByName(element=watch_5, parameterName=code_block_3.out3, value=string_from_object_6, lacing=Shortest)

# group: Edit Box Width and Height
# note: Divided by 50 because this legend is in 1:50 scale
code_block_7 = CodeBlock { "Table Width"; }
scale = CodeBlock { 50; }
code_block_8 = CodeBlock(x=getParameterValueByName_2, scale=scale) { (x/scale)+25; }
desired_box_width = CodeBlock { 4500; }
code_block_9 = CodeBlock(x=desired_box_width, scale=scale) { x/scale; }
gt = code_block_8 > code_block_9
if_ = If(test=gt, true=code_block_8, false=code_block_9)
setParameterByName_5 = Element.SetParameterByName(element=watch_2, parameterName=code_block_7, value=if_, lacing=Shortest)
code_block_10 = CodeBlock { "Table Height (Door Elevation)"; }
code_block_11 = CodeBlock(x=getParameterValueByName_3, scale=scale) { (x/scale)+25; }
desired_box_height = CodeBlock { 4500; }
code_block_12 = CodeBlock(x=desired_box_height, scale=scale) { x/scale; }
gt_2 = code_block_11 > code_block_12
if_2 = If(test=gt_2, true=code_block_11, false=code_block_12)
setParameterByName_6 = Element.SetParameterByName(element=watch_2, parameterName=code_block_10, value=if_2, lacing=Shortest)
