# Dynamo graph Create_Schedule_GFA.dyn "Create_Excel" (Dynamo 2.6.1.8786)
# packages: bimorphNodes 3.0.3

# group: License
# note: GNU License
# This program is free software, you can redistribute it and/or modify it under the terms GNU General Public License as pubmished by the Free Software Foundation, either version 3 of the License, or (at your option) any later version.
# This program is distributed in the hope that it will be useful, but WITHOUT ANY WARRANTY, without even the implied warranty of MERCHANTABILITY or FITNESS FOR A PARTICULAR PURPOSE. See the GNU General Public License for more details.
# You should have received a copy of the GNU General Public License along with this program. If not, see http://www.gnu.org/licenses/

# group: Background
# note: for workflow

# group: Input
# note: for selection and whatnot

# group: Control
# note: for sliders and other option

# group: To Revit
# note: for changes made to Revit

# group: Annotation
# note: for notes and titles

# group: Info
# note: for general information

# group: Other
# note: for general other needs

# note: Case Sensitive
string = StringInput("ROOM SCHEDULE")

# group: Input
# note: SHOUTOUTS!
# -Bimorph package needed for Schedule.GetData node
directory_path = Directory("C:\Users\GCUCSBWS112\Desktop")
string_2 = StringInput("Document 1")
code_block = CodeBlock { 0; }
# note: Custom Package: BimorphNodes v.3.0.3
getData = Revit.Schedule.GetData(scheduleView=string)
boolean = BoolSelector(true)

exportExcel = Data.ExportExcel(filePath=directory_path, sheetName=string_2, startRow=code_block, startCol=code_block, data=getData, overWrite=boolean)
