# Dynamo graph Create_Legend_WindowSchedule_script.dyn (Dynamo 2.6.1.8786)
# packages: spring nodes 204.1.0

# group: Selecting current generic annotation and legend
# note: README
# 1.springs packege for current selection in revit node
# 2. Scale determines the size of box
# 3. Only one legend window and annotation box allowed at a time
ꟿ_collect_currentselection = Custom[ꟿ Collect.CurrentSelection]()  # package spring nodes; Gets the currently selected elements. Connect a boolean switch to refresh the selection.
getCategory = Element.GetCategory(element=ꟿ_collect_currentselection)
watch = Watch(getCategory)
string_from_object = FromObject(obj=watch)
string = StringInput("Generic Annotations")
boolean = BoolSelector(false)
contains = String.Contains(str=string_from_object, searchFor=string, ignoreCase=boolean)
filterByBoolMask = List.FilterByBoolMask(list=ꟿ_collect_currentselection, mask=contains)

# group: Extract parameter values
watch_2 = Watch(filterByBoolMask.out)
code_block = CodeBlock { "Component Type"; }
parameterByName = Parameter.ParameterByName(element=filterByBoolMask.out, name=code_block, lacing=Shortest)
string_from_object_2 = FromObject(obj=parameterByName)
code_block_2 = CodeBlock { ": "; }
split = String.Split(str=string_from_object_2, separator0=code_block_2, lacing=Shortest)
lastItem = List.LastItem(list=split, lacing=Longest)

watch_3 = Watch(filterByBoolMask.in)
watch_4 = Watch(watch_3)
code_block_3 = CodeBlock { "Window Type Mark"; "Window Width"; "Window Height"; "Window Sill Height"; "Window Description"; }
byName = FamilyType.ByName(name=lastItem, lacing=Shortest)
code_block_4 = CodeBlock { "Type Mark"; "Width"; "Height"; "Default Sill Height"; "Description"; }
getParameterValueByName = Element.GetParameterValueByName(element=byName, parameterName=code_block_4.out0)
string_from_object_3 = FromObject(obj=getParameterValueByName)
setParameterByName = Element.SetParameterByName(element=watch_4, parameterName=code_block_3.out0, value=string_from_object_3, lacing=Shortest)
getParameterValueByName_2 = Element.GetParameterValueByName(element=byName, parameterName=code_block_4.out1)
string_from_object_4 = FromObject(obj=getParameterValueByName_2)
code_block_5 = CodeBlock { "."; }
split_2 = String.Split(str=string_from_object_4, separator0=code_block_5)
code_block_6 = CodeBlock { 0; }
getItemAtIndex = List.GetItemAtIndex(list=split_2@L2, index=code_block_6)
setParameterByName_2 = Element.SetParameterByName(element=watch_4, parameterName=code_block_3.out1, value=getItemAtIndex, lacing=Shortest)
getParameterValueByName_3 = Element.GetParameterValueByName(element=byName, parameterName=code_block_4.out2)
string_from_object_5 = FromObject(obj=getParameterValueByName_3)
code_block_7 = CodeBlock { "."; }
split_3 = String.Split(str=string_from_object_5, separator0=code_block_7)
code_block_8 = CodeBlock { 0; }
getItemAtIndex_2 = List.GetItemAtIndex(list=split_3@L2, index=code_block_8)
setParameterByName_3 = Element.SetParameterByName(element=watch_4, parameterName=code_block_3.out2, value=getItemAtIndex_2, lacing=Shortest)
getParameterValueByName_4 = Element.GetParameterValueByName(element=byName, parameterName=code_block_4.out3)
string_from_object_6 = FromObject(obj=getParameterValueByName_4)
code_block_9 = CodeBlock { "."; }
split_4 = String.Split(str=string_from_object_6, separator0=code_block_9)
code_block_10 = CodeBlock { 0; }
getItemAtIndex_3 = List.GetItemAtIndex(list=split_4@L2, index=code_block_10)
setParameterByName_4 = Element.SetParameterByName(element=watch_4, parameterName=code_block_3.out3, value=getItemAtIndex_3, lacing=Shortest)

# group: Edit Box Width and Height
# note: Divided by 50 because this legend is in 1:50 scale
code_block_11 = CodeBlock { "Table Width"; }
scale = CodeBlock { 50; }
code_block_12 = CodeBlock(x=getParameterValueByName_2, scale=scale) { (x/scale)+25; }
desired_box_width = CodeBlock { 4500; }
code_block_13 = CodeBlock(x=desired_box_width, scale=scale) { x/scale; }
gt = code_block_12 > code_block_13
if_ = If(test=gt, true=code_block_12, false=code_block_13)
setParameterByName_5 = Element.SetParameterByName(element=watch_3, parameterName=code_block_11, value=if_, lacing=Shortest)
code_block_14 = CodeBlock { "Table Height (Window Elevation)"; }
code_block_15 = CodeBlock(x=getParameterValueByName_3, scale=scale) { (x/scale)+25; }
desired_box_height = CodeBlock { 4500; }
code_block_16 = CodeBlock(x=desired_box_height, scale=scale) { x/scale; }
gt_2 = code_block_15 > code_block_16
if_2 = If(test=gt_2, true=code_block_15, false=code_block_16)
setParameterByName_6 = Element.SetParameterByName(element=watch_3, parameterName=code_block_14, value=if_2, lacing=Shortest)

getParameterValueByName_5 = Element.GetParameterValueByName(element=byName, parameterName=code_block_4.out4)
string_from_object_7 = FromObject(obj=getParameterValueByName_5)
setParameterByName_7 = Element.SetParameterByName(element=watch_4, parameterName=code_block_3.out4, value=string_from_object_7, lacing=Shortest)
